# Grasshopper definition 哈曼卡顿.gh (Grasshopper 1.0.8)
# plug-ins: Pufferfish, MosquitoAudio2, Hare, Bifocals, Vipers

crv = Curve([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])
crv_2 = Curve(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)
crv_3 = Curve(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)
crv_4 = Curve([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])
crv_5 = Curve([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])
crv_6 = Curve(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)
crv_7 = Curve(<curve referenced from the Rhino model>)
crv_8 = Curve([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])
crv_9 = Curve(crv_4)
crv_10 = Curve(crv_8)
srf = Surface(<surface referenced from the Rhino model>)
srf_2 = Surface(<surface referenced from the Rhino model>)
rebcrv = RebuildCurve(Curve=crv_9, Count=Slider(72, range=0..100), Degree="3", EndTangents=False)
rebcrv_2 = RebuildCurve(Count=Slider(16, range=0..100), Degree="3", EndTangents=False)
trigger = Trigger(Interval=1000, TimerInterval=1000, Target=time)  # disabled
area = Area(Geometry=srf)  # -> Area, Centroid
pdecon = Deconstruct(Point=area.Centroid)  # -> XComponent, YComponent, ZComponent
brep = Brep([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])
brep_2 = Brep([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])
expression = Expression(x=pdecon.XComponent, Expression="if(x<46,0,1)")
division = Division(A=pdecon.YComponent, B=4)
number_slider = Slider(0.15, range=0..1)
time = Time("now")
loft = Loft(Curves=crv_9, Options={Adjust=False, Closed=False, LoftEnds=0, LoftSimp=0, LoftType=0, Rebuild=10, Refit=0.01})
X = UnitX(Factor=Slider(3, range=0..10))
ddate = DeconstructDate(Date=time)  # -> Year, Month, Day, Hour, Minute, Second
abs = Absolute(Value=division)
brep_3 = Brep(brep_2)
int = Integer(abs)
expression_2 = Expression(x=ddate.Second, Expression="-1^x")
move = Move(Geometry=rebcrv_2, Motion=X)  # -> Geometry, Transform
lng = ListLength(List=brep_3)
number_slider_2 = Slider(8, range=0..10)
path = FilePath("F:\工作\2026\2026-05-13_harman-kardon\music\miside.mp3")
path_2 = FilePath("F:\工作\2026\2026-05-13_harman-kardon\music\Hiromitsu Maeba - A Prosecutor, Reborn (复活的检察官).mp3")
path_3 = FilePath("F:\工作\2026\2026-05-13_harman-kardon\music\Yasumasa Kitagawa - Ryunosuke Naruhodo - Overture to Resolve (成步堂龙之介〜觉悟的序曲).mp3")
path_4 = FilePath("F:\工作\2026\2026-05-13_harman-kardon\music\Life is Full of Happiness.mp3")
number_slider_3 = Slider(8, range=0..10)
subtraction = Subtraction(A=lng, B=1)
multiplication = Multiplication(A=expression_2, B=number_slider)
loft_2 = Loft(Curves=move.Geometry, Options={Adjust=False, Closed=False, LoftEnds=0, LoftSimp=0, LoftType=0, Rebuild=10, Refit=0.01})
subtraction_2 = Subtraction(A="1", B=number_slider)
range = Range(Domain=Domain(0, 1), Steps=subtraction)
filter = StreamFilter(Gate=int, Stream0=path, Stream1=path_4, Stream2=path_2, Stream3=path_3)
play = AudioPlay(AudioFile=filter, Boolean=expression)
addition = Addition(A=multiplication, B=subtraction_2)
division_2 = Division(A="360", B=number_slider_2)
division_3 = Division(A="360", B=number_slider_3)
smooth = SmoothNumbers(Numbers=addition, SmoothDelay=2000)
R = RecordeData(Data=play, Count="1")
series = Series(Start=0, Step=division_2, Count=number_slider_2)
panel = Panel(ddate.Second)
series_2 = Series(Start=0, Step=division_3, Count=number_slider_3)
rotate = Rotate(Geometry=loft, Angle=degrees(series), Plane=PlaneXY(0, 0, 0))  # -> Geometry, Transform
rotate_2 = Rotate(Geometry=loft_2, Angle=degrees(series_2), Plane=PlaneXY(0, 0, 0))  # -> Geometry, Transform
expression_3 = Expression(x=R, Expression="if(x>1.01,0,x)")
not = GateNot()
panel_2 = Panel(R)
loft_opt = LoftOptions(Closed=Toggle(True), Adjust=False, Rebuild=0, Refit=0, Type=0)
loft_opt_2 = LoftOptions(Closed=Toggle(True), Adjust=False, Rebuild=0, Refit=0, Type=0)
multiplication_2 = Multiplication(A=expression_3, B=Slider(0.2, range=0..0.5))
loft_3 = Loft(Curves=rotate.Geometry, Options=loft_opt)
loft_4 = Loft(Curves=rotate_2.Geometry, Options=loft_opt_2)
area_2 = Area(Geometry=srf_2)  # -> Area, Centroid
pdecon_2 = Deconstruct(Point=area_2.Centroid)  # -> XComponent, YComponent, ZComponent
Z = UnitZ(Factor=Slider(9, range=0..10))
expression_4 = Expression(x=pdecon_2.XComponent, Expression="if(x<26,0,1)")
division_4 = Division(A=pdecon_2.YComponent, B=4)
abs_2 = Absolute(Value=division_4)
move_2 = Move(Geometry=loft_4, Motion=Z)  # -> Geometry, Transform
addition_2 = Addition(A=expression_4, B=abs_2)
expression_5 = Expression(x=pdecon_2.YComponent, Expression="if(x>-1,0,1)")
brep_4 = Brep([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])
debrep = DeconstructBrep(Brep=move_2.Geometry)  # -> Faces, Edges, Vertices
filter_2 = StreamFilter(Gate=expression_4, Stream0="grey", Stream1=ColourSwatch(SwatchColor=RGB(255, 229, 125)))
multiplication_3 = Multiplication(A=addition_2, B=Slider(0.3, range=0..1))
item = ListItem(List=debrep.Faces, Index=0, Wrap=True)
and = GateAnd(A=expression_4, B=expression_5)
smooth_2 = SmoothNumbers(Numbers=expression_4, SmoothDelay=1000)
preview = CustomPreview(Geometry=brep_4, Material=filter_2)
rhombus = 菱形网格(Surface=item, UCount=Slider(24, range=0..100), VCount=Slider(8, range=0..100))  # -> flatten(Rhombus), Triangles
addition_3 = Addition(A=expression_4, B=and)
panel_3 = Panel(addition_3)
smaller = SmallerThan(FirstNumber=panel_3, SecondNumber="2")  # -> SmallerThan, OrEqualTo
filter_3 = StreamFilter(Gate=[not, smaller.SmallerThan], Stream0="1", Stream1=smooth)
gradient = Gradient(LowerLimit=0, UpperLimit=filter_3, Parameter=range, stops=[0: RGB(0, 0, 0), 1: RGB(255, 255, 255)])
gradient_2 = Gradient(
    LowerLimit=0,
    UpperLimit=filter_3,
    Parameter=range,
    stops=[0.117: RGB(20, 40, 60), 0.75: RGBA(0, 255, 255, 143), 1: RGBA(199, 255, 255, 131)])
ahsv = SplitAHSV(Colour=gradient)  # -> Alpha, Hue, Saturation, Value
ahsv_2 = SplitAHSV(Colour=gradient_2)  # -> Alpha, Hue, Saturation, Value
addition_4 = Addition(A=multiplication_2, B=ahsv_2.Hue)
multiplication_4 = Multiplication(A=ahsv_2.Saturation, B=Slider(0.75, range=0..1))
hsv = ColourHSV(Alpha=1, Hue=ahsv.Hue, Saturation=ahsv.Saturation, Value=ahsv.Value)
addition_5 = Addition(A=addition_4, B=multiplication_3)
mod = Modulus(A=addition_5, B=1)
multiplication_5 = Multiplication(A=hsv, B=smooth_2)
flip = FlipMatrix(Data=rhombus.Triangles)
hsv_2 = ColourHSV(Alpha=1, Hue=mod, Saturation=multiplication_4, Value=ahsv_2.Value)
item_2 = ListItem(List=flip, Index=0, Wrap=True)  # -> Item, Item1
filter_4 = StreamFilter(Gate=panel_3, Stream0=ColourSwatch(SwatchColor=RGB(43, 43, 43)), Stream1=multiplication_5, Stream2=hsv_2)
crv_11 = Curve(flatten([item_2.Item1, rhombus.Rhombus]))
disc = Discontinuity(Curve=crv_11, Level=1)  # -> Points, Parameters
avr = Average(Input=disc.Points)
preview_2 = CustomPreview(Geometry=brep_3, Material=filter_4)
scale = Scale(Geometry=graft(crv_11), Center=avr, Factor=Slider(0.95, range=0..1))  # -> Geometry, Transform
srf_3 = Surface(scale.Geometry)
edges = BrepEdges(Brep=item)  # -> Naked, Interior, NonManifold
srf_4 = Surface(srf_3)
debrep_2 = DeconstructBrep(Brep=flatten(srf_4))  # -> Faces, Edges, Vertices
crv_12 = Curve(edges.Naked)
item_3 = ListItem(List=edges.Naked, Index=0, Wrap=True)
avr_2 = Average(Input=debrep_2.Vertices)
pull = PullPoint(Point=flatten(avr_2), Geometry=crv_12, ClosestOnly=True)  # -> ClosestPoint, Distance, Index
sort = SortList(Keys=flatten(pull.Distance), ValuesA=flatten(srf_3))  # -> Keys, ValuesA
sort_2 = SortList(Keys=pull.Distance, ValuesA=flatten(avr_2))  # -> Keys, ValuesA
sort_3 = SortList(Keys=pull.Distance, ValuesA=flatten(srf_4))  # -> Keys, ValuesA
映射 = 映射(V=sort_3.Keys, A=Slider(0.1, range=0..1), B=Slider(1, range=0..10))  # -> graft(R)
Z_2 = UnitZ(Factor=映射)
pull_2 = PullPoint(Point=flatten(sort_2.ValuesA), Geometry=item_3, ClosestOnly=True)  # -> ClosestPoint, Distance, Index
move_3 = Move(Geometry=graft(sort_3.ValuesA), Motion=Z_2)  # -> Geometry, Transform
sort_4 = SortList(Keys=flatten(pull_2.Distance), ValuesA=flatten(sort_2.ValuesA))  # -> Keys, graft(ValuesA)
sort_5 = SortList(Keys=flatten(pull_2.Distance), ValuesA=flatten(sort.ValuesA))  # -> Keys, graft(ValuesA)
sort_6 = SortList(Keys=flatten(pull_2.Distance), ValuesA=flatten(move_3.Geometry))  # -> Keys, graft(ValuesA)
unifycurve = 顺时针方向统一曲线(Curve=sort_6.ValuesA, Plane=PlaneXY(0, 0, 0), Reverse=True)  # -> Curve, Judgement
flip_2 = FlipCurve(Curve=sort_5.ValuesA)  # -> Curve, Flag
映射_2 = 映射(V=pull_2.Distance, A=Slider(0.6, range=0..1), B=Slider(0.9, range=0..1))  # -> graft(R)
pull_3 = PullPoint(Point=flatten(sort_4.ValuesA), Geometry=item_3, ClosestOnly=True)  # -> ClosestPoint, Distance, Index
unifycurve_2 = 顺时针方向统一曲线(Curve=flip_2.Curve, Plane=PlaneXY(0, 0, 0), Reverse=True)  # -> Curve, Judgement
number_slider_4 = Slider(0.1, range=0..0.1)
scale_2 = Scale(Geometry=unifycurve.Curve, Center=sort_4.ValuesA, Factor=映射_2)  # -> Geometry, Transform
fillet = Fillet(Curve=unifycurve_2.Curve, Radius=number_slider_4)  # -> simplify(Curve)
fillet_2 = Fillet(Curve=scale_2.Geometry, Radius=number_slider_4)  # -> simplify(Curve)
cp = ControlPoints(Curve=fillet_2)  # -> Points, Weights, Knots
plfit = PlaneFit(Points=cp.Points)  # -> Plane, Deviation
projecta = ProjectAlong(Geometry=fillet_2, Plane=plfit.Plane, Direction=Vector(0, 0, -1))  # -> Geometry, Transform
area_3 = Area(Geometry=projecta.Geometry)  # -> Area, Centroid
scale_3 = Scale(Geometry=projecta.Geometry, Center=area_3.Centroid, Factor=Slider(0.8, range=0..1))  # -> Geometry, Transform
weave = Weave(Pattern=[0, 1, 2], Stream0=scale_3.Geometry, Stream1=projecta.Geometry, Stream2=fillet, NullGaps=False)
loft_5 = Loft(Curves=weave, Options={Adjust=False, Closed=False, LoftEnds=0, LoftSimp=0, LoftType=1, Rebuild=10, Refit=0.01})
weave_2 = Weave(Pattern=[0, 1], Stream0=loft_5, Stream1=scale_3.Geometry, NullGaps=False)
join = BrepJoin(Breps=weave_2)  # -> flatten(Breps), Closed
sort_7 = SortList(Keys=pull_3.Distance, ValuesA=join.Breps)  # -> Keys, reverse(ValuesA)
preview_3 = CustomPreview(
    Geometry=sort_7.ValuesA,
    Material={diffuse=RGB(221, 160, 221), emission=RGB(66, 48, 66), shine=0.5, specular=RGB(255, 255, 255), transparency=0})

# ==== cluster 映射: 区间映射
A = ClusterInput()
B = ClusterInput()
V = ClusterInput()
dom = ConstructDomain(DomainStart=A, DomainEnd=B)
bnd = Bounds(Numbers=V)  # -> flatten(Domain)
remap = RemapNumbers(Value=V, Source=bnd, Target=dom)  # -> Mapped, Clipped
R = ClusterOutput(remap.Mapped)
